# Grasshopper definition Curveature Recursion.gh (Grasshopper 1.0.7)

list = ValueList({"maximum_principal_curvature": 2, "minimum_principal_curvature": 4, "gaussian_curvature": 6, "mean_curvature": 7}, selected="maximum_principal_curvature")
srf = Surface(<surface referenced from the Rhino model>)
python = GhPythonScript(surface=srf, count=Slider(3, range=0..25), uu=Slider(0.673, range=0..1), vv=Slider(0.614, range=0..1), evaluate=list)  # -> allSrf, IsoSrf, allPt, allN; inputs surface: Surface, count: Int32
# ---------- python: Python ----------
__author__ = "ashkanism"
__version__ = "2020.11.12"

import rhinoscriptsyntax as rs
import Rhino
import Rhino.Geometry as rg
from Grasshopper import DataTree

# For accesssing GH classes
from Grasshopper.Kernel.Types import UVInterval
from Grasshopper.Kernel.Types import GH_Interval


dom = rg.Interval(0,1)
surface.SetDomain(0,dom)
surface.SetDomain(1,dom)

srf = surface
allSrf = []
allPt = []
allN = []

for i in range(0,count):
    
    IsoSrf = []
    ULength = rs.SurfaceDomain(srf, 0)
    VLength = rs.SurfaceDomain(srf, 1)
    
    u0  = 0
    u1 = uu
    u2 = 1
    v0 = 0 
    v1 = vv
    v2 = 1
    U1 = Rhino.Geometry.Interval(u0,u1)
    U2 = Rhino.Geometry.Interval(u1,u2)
    V1 = Rhino.Geometry.Interval(v0,v1)
    V2 = Rhino.Geometry.Interval(v1,v2)
    
    UVList  = [UVInterval(U1,V1), UVInterval(U1,V2),UVInterval(U2,V1),UVInterval(U2,V2)]
    
    srf0 = Rhino.Geometry.Surface.Trim(srf,U1 , V1)
    srf1 = Rhino.Geometry.Surface.Trim(srf,U1, V2)
    srf2 = Rhino.Geometry.Surface.Trim(srf,U2, V1)
    srf3 = Rhino.Geometry.Surface.Trim(srf,U2, V2)
    
    IsoSrf.append(srf0)
    IsoSrf.append(srf1)
    IsoSrf.append(srf2)
    IsoSrf.append(srf3)
    
    maxCr = 0
    srfIndex = 0
    pointCr = []
    pointN = []
    
    for i in range(0,len(IsoSrf)):
        basicInterval =  Rhino.Geometry.Interval(0,1)
        IsoSrf[i].SetDomain(0, basicInterval) 
        IsoSrf[i].SetDomain(1, basicInterval) 
        result = rs.SurfaceCurvature(IsoSrf[i], (0.5, 0.5))
        pointCr.append(result[0])
        pointN.append(result[1])
        
        if(result[evaluate] >= maxCr):
            maxCr = result[2]
            srfIndex = i
    srf = IsoSrf[srfIndex]
    IsoSrf.pop(srfIndex)
    pointCr.pop(srfIndex)
    pointN.pop(srfIndex)
    allSrf.extend(IsoSrf)
    allPt.extend(pointCr)
    allN.extend(pointN)
    
    a = maxCr

#All the Surfaces
allSrf.append(srf)

#MiddlePoint for the Last Surface
basicInterval =  Rhino.Geometry.Interval(0,1)
srf.SetDomain(0, basicInterval) 
srf.SetDomain(1, basicInterval) 
result = rs.SurfaceCurvature(srf, (0.5, 0.5))
allPt.append(result[0])
allN.append(result[1])
# ---------- end python ----------
unit = UnitVector(Vector=python.allN)
srf_2 = Surface(python.allSrf)
pt = Point(python.allPt)
amp = Amplitude(Vector=unit, Amplitude=Slider(356.2, range=0..1000))
move = Move(Geometry=srf_2, Motion=amp)  # -> Geometry, Transform
vdis = VectorDisplay(Anchor=pt, Vector=amp)
