# Grasshopper definition 210313 Grid Structure.gh (Grasshopper 1.0.7)

# ashkanism
# Paypal: aashkann@outlook.com
# Making a grid structure from random points
# random points
pt = Point([Point(-13738.69577, -8501.380847, 0), Point(-13738.69577, -4470.88572, 0), Point(-13738.69577, -440.3905937, 0), Point(-13738.69577, 3590.104533, 0), Point(-13738.69577, 7620.59966, 0), Point(-13738.69577, 11651.09479, 0)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])
python = GhPythonScript(pts=pt)  # -> gridX, gridY; inputs pts: list of Point3d
# ---------- python: Python ----------
__author__ = "ashkanism"
__version__ = "2021.03.13"

import rhinoscriptsyntax as rs
from Grasshopper import DataTree
from Rhino.Geometry import Point3d
import Rhino as R
import ghpythonlib.components as ghC
from Grasshopper.Kernel.Data import GH_Path 

tol = 0.01;
xList = []
yList = []
xKey = []
yKey = []

gridX = DataTree[Point3d]()
gridY = DataTree[Point3d]()

for i in range(len(pts)):
    xList.append(pts[i].X)
    yList.append(pts[i].Y)
    
    
for i in xList: 
    if i not in xKey: 
        xKey.append(i)
        
for i in yList: 
    if i not in yKey: 
        yKey.append(i)


#xKey.sort()
a = xKey

for m in range(len(xKey)):
    for k in range(len(pts)):
        if(pts[k].X >= xKey[m] - tol and pts[k].X <= xKey[m] + tol):
            newPath = GH_Path(m)
            gridX.Add(pts[k], newPath)
            
for m in range(len(yKey)):
    for k in range(len(pts)):
        if(pts[k].Y >= yKey[m] - tol and pts[k].Y <= yKey[m] + tol):
            newPath = GH_Path(m)
            gridY.Add(pts[k], newPath)
# ---------- end python ----------
dots = DotDisplay(Point=pt, Colour=RGB(10, 0, 0), Size=Slider(200, range=0..1000))
pline = PolyLine(Vertices=python.gridX, Closed=False)
pline_2 = PolyLine(Vertices=python.gridY, Closed=False)
