# Grasshopper definition Ghpython Pinched Grid.gh (Grasshopper 1.0.7)

number_slider = Slider(997.41, range=0..3000)
number_slider_2 = Slider(42, range=0..100)
number_slider_3 = Slider(123.322, range=0..1000)
# aashkann.com
# aashkann@outlook.com
P = Plane(Plane(origin=(-1193.300861, 20057.36683, 0), x=(0, 1, 0), y=(-1, 0, 0)))
recgrid = Rectangular(Plane=P, SizeX=number_slider_3, SizeY=number_slider_3, ExtentX=number_slider_2, ExtentY=number_slider_2)  # -> Cells, Points
bbox = BoundingBox(Content=flatten(recgrid.Points), Plane=PlaneXY(0, 0, 0), UnionBox=True)  # -> Box, Box_2
pop2d = Populate2D(Region=bbox.Box, Count=Slider(7, range=0..10), Seed=Slider(4, range=0..10))
pt = Point(recgrid.Points)
pt_2 = Point(pop2d)
cir = Circle(Plane=pt_2, Radius=number_slider)
points = PointList(Points=cir, Size=Slider(100, range=0..100))
python = GhPythonScript(gPoints=pt, pPoints=pt_2, threshold=number_slider)  # -> out, alteredGrid; inputs gPoints: tree of Point3d, pPoints: list of Point3d
# ---------- python: Python ----------
__author__ = "ashkanism"
__version__ = "2021.01.03"

import rhinoscriptsyntax as rs
import math as m
import Rhino.Geometry as rg
import Grasshopper.DataTree as Gtree
from Grasshopper.Kernel.Data import GH_Path
import ghpythonlib.treehelpers as th


branchNum = gPoints.BranchCount
memberNum = gPoints.DataCount
collectionNum = int(memberNum/branchNum)
allpath = []
minIndex = 0
ptToCompare = (0,0,0)

for j in range(0,branchNum):
    for b in range(0, collectionNum):
        dist = []
        sortDist = []
        gridPoint = gPoints.Branch(j)[b]
        
        #Calculating distances to find a closest points
        for i in range(0, len(pPoints)):
            distances = rs.Distance(gridPoint, pPoints[i])
            sortDist.append(distances)
            dist.append(distances)
        
        #Sorting the sortDsit list and defind minimum value
        sortDist.sort()
        minValue = sortDist[0]
        #Finding the point and its index number
        for m in range(0,len(dist)):
            if(dist[m] == minValue):
                ptToCompare = pPoints[m]
                minIndex = m
        #Calculating distances to the closest point and remove points
        closDist = rs.Distance(gridPoint, ptToCompare)
        if(closDist < threshold):
            gPoints.Branch(j)[b] = ptToCompare
            
            
            
alteredGrid = gPoints
# ---------- end python ----------
pt_3 = Point(python.alteredGrid)
flip = FlipMatrix(Data=pt_3)  # -> simplify(Data)
merge = Merge(Data1=pt_3, Data2=flip)
pline = PolyLine(Vertices=merge, Closed=False)
divide = DivideCurve(Curve=pline, Count=Slider(7, range=0..100), Kinks=False)  # -> Points, Tangents, Parameters
intcrv = Interpolate(Vertices=divide.Points, Degree=3, Periodic=False, KnotStyle=1)  # -> Curve, Length, Domain
