# Grasshopper definition Simple Curveature Recursion.gh (Grasshopper 1.0.7)
# plug-ins: Human

list = ValueList({"maximum_principal_curvature": 2, "minimum_principal_curvature": 4, "gaussian_curvature": 6, "mean_curvature": 7}, selected="minimum_principal_curvature")
# ashkanism
number_slider = Slider(4, range=0..25)
srf = Surface(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)
python = GhPythonScript(surface=srf, count=number_slider, uu=Slider(0.757, range=0..1), vv=Slider(0.601, range=0..1), evaluate=list)  # -> allSrf, IsoSrf, allPt, allN; inputs surface: Surface, count: Int32
# ---------- python: Python ----------
__author__ = "ashkanism"
__version__ = "2020.11.12"

import rhinoscriptsyntax as rs
import Rhino
from Grasshopper import DataTree

# For accesssing GH classes
from Grasshopper.Kernel.Types import UVInterval
from Grasshopper.Kernel.Types import GH_Interval

srf = surface
allSrf = []
allPt = []
allN = []

for i in range(0,count):
    
    IsoSrf = []
    ULength = rs.SurfaceDomain(srf, 0)
    VLength = rs.SurfaceDomain(srf, 1)
    
    u0  = 0
    u1 = uu
    u2 = 1
    v0 = 0 
    v1 = vv
    v2 = 1
    U1 = Rhino.Geometry.Interval(u0,u1)
    U2 = Rhino.Geometry.Interval(u1,u2)
    V1 = Rhino.Geometry.Interval(v0,v1)
    V2 = Rhino.Geometry.Interval(v1,v2)
    
    UVList  = [UVInterval(U1,V1), UVInterval(U1,V2),UVInterval(U2,V1),UVInterval(U2,V2)]
    
    srf0 = Rhino.Geometry.Surface.Trim(srf,U1, V1)
    srf1 = Rhino.Geometry.Surface.Trim(srf,U1, V2)
    srf2 = Rhino.Geometry.Surface.Trim(srf,U2, V1)
    srf3 = Rhino.Geometry.Surface.Trim(srf,U2, V2)
    
    IsoSrf.append(srf0)
    IsoSrf.append(srf1)
    IsoSrf.append(srf2)
    IsoSrf.append(srf3)
    
    maxCr = 0
    srfIndex = 0
    pointCr = []
    pointN = []
    
    for i in range(0,len(IsoSrf)):
        basicInterval =  Rhino.Geometry.Interval(0,1)
        IsoSrf[i].SetDomain(0, basicInterval) 
        IsoSrf[i].SetDomain(1, basicInterval) 
        result = rs.SurfaceCurvature(IsoSrf[i], (0.5, 0.5))
        pointCr.append(result[0])
        pointN.append(result[1])
        
        if(result[evaluate] >= maxCr):
            maxCr = result[2]
            srfIndex = i
    srf = IsoSrf[srfIndex]
    IsoSrf.pop(srfIndex)
    pointCr.pop(srfIndex)
    pointN.pop(srfIndex)
    allSrf.extend(IsoSrf)
    allPt.extend(pointCr)
    allN.extend(pointN)
    
    a = maxCr

#All the Surfaces
allSrf.append(srf)

#MiddlePoint for the Last Surface
basicInterval =  Rhino.Geometry.Interval(0,1)
srf.SetDomain(0, basicInterval) 
srf.SetDomain(1, basicInterval) 
result = rs.SurfaceCurvature(srf, (0.5, 0.5))
allPt.append(result[0])
allN.append(result[1])
# ---------- end python ----------
amp = Amplitude(Vector=python.allN, Amplitude=Slider(525.28, range=0..1000))
pt = Point(python.allPt)
srf_2 = Surface(python.allSrf)
vdis = VectorDisplay(Anchor=pt, Vector=amp)

# ----
# Extrusion
debrep = DeconstructBrep(Brep=srf_2)  # -> Faces, Edges, Vertices
pdecon = Deconstruct(Point=debrep.Vertices)  # -> XComponent, YComponent, ZComponent
pdecon_2 = Deconstruct(Point=pt)  # -> XComponent, graft(YComponent), graft(ZComponent)
subtraction = Subtraction(A=pdecon.YComponent, B=pdecon_2.YComponent)
neg = Negative(Value=subtraction)
Y = UnitY(Factor=neg)
move = Move(Geometry=debrep.Vertices, Motion=Y)  # -> Geometry, Transform
flip = FlipMatrix(Data=move.Geometry)
bang = ExplodeTree(Data=flip)  # -> Branch0, Branch1, Branch2, Branch3
srf4pt = _4PointSurface(CornerA=bang.Branch0, CornerB=bang.Branch1, CornerC=bang.Branch2, CornerD=bang.Branch3)
area = Area(Geometry=srf4pt)  # -> Area, Centroid
pdecon_3 = Deconstruct(Point=area.Centroid)  # -> XComponent, YComponent, ZComponent
subtraction_2 = Subtraction(A=pdecon_3.YComponent, B=Slider(529.959, range=0..1000))
Y_2 = UnitY(Factor=subtraction_2)
neg_2 = Negative(Value=Y_2)
extr = Extrude(Base=srf4pt, Direction=neg_2)
edges = BrepEdges(Brep=extr)  # -> Naked, Interior, NonManifold

number_slider_2 = Slider(0.089, range=0..1)
number_slider_3 = Slider(0.689, range=0..1)
swatch = ColourSwatch(SwatchColor=RGB(199, 193, 193))
# Preview
swatch_2 = ColourSwatch(SwatchColor=RGB(191, 90, 90))
range = Range(Domain=Domain(0, 1), Steps=Slider(31, range=0..100))  # -> reverse(Range)
multiplication = Multiplication(A=range, B=Slider(2.12, range=0..10))
material = CreateMaterial(
    Diffuse=ColourSwatch(SwatchColor=RGB(0, 0, 0)),
    Specular=swatch,
    Emission=RGB(0, 0, 0),
    Transparency=number_slider_2,
    Shine=number_slider_3)
material_2 = CreateMaterial(Diffuse=swatch_2, Specular=swatch, Emission=RGB(0, 0, 0), Transparency=number_slider_2, Shine=number_slider_3)
previewlw = CustomPreviewLineweights(Geometry=edges.Interior, Shader=material, Thickness=graft(multiplication), Absolute=False)
preview = CustomPreview(Geometry=extr, Material=material_2)
