# Grasshopper definition SrfLengthDivide.gh (Grasshopper 1.0.7)

# ashkanism
# Paypal: ashkan.rezaee@hotmail.com
number_slider = Slider(1011.66, range=0..6250)
srf = Surface(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)
dividesrf = GhPythonScript(surface=srf, ULength=number_slider, VLength=Slider(270, range=0..3500))  # -> IsoSrf, Udomain, Vdomain, UV, remainderU, remainderV, srfULength, srfVLength, nMax, mMax; inputs surface: Surface
# ---------- dividesrf: Python ----------
__author__ = "ash"
__version__ = "2020.04.30"

import rhinoscriptsyntax as rs
import Rhino
from Grasshopper import DataTree

# For accesssing GH classes
from Grasshopper.Kernel.Types import UVInterval
from Grasshopper.Kernel.Types import GH_Interval


srf = surface
length = []
Udomain = []
UdomainDown = []
UdomainUp = []
Vdomain = []
UV = []
a = []
IsoSrf = []

srfULength = rs.SurfaceDomain(srf, 0)
srfVLength = rs.SurfaceDomain(srf, 1)

#UDomain Calculation

remainderU = srfULength[1]%ULength
equalU = int(srfULength[1]//ULength)
remainderV = srfVLength[1]%VLength
equalV = int(srfVLength[1]//VLength)

for j in range(0,equalU):
    Udown = j*ULength
    Uup = (j+1)*ULength
    Udomain.append(Rhino.Geometry.Interval(Udown,Uup))
    
for k in range(0,equalV):
    Vdown = k*VLength
    Vup = (k+1)*VLength
    Vdomain.append(Rhino.Geometry.Interval(Vdown,Vup))

netU = equalU * ULength
remainderUU =  equalU * ULength + remainderU
netV = equalV * VLength
remainderVV =  equalV * VLength + remainderV

if(remainderU !=0):
    Udomain.append(Rhino.Geometry.Interval(netU,remainderUU))
if(remainderV !=0):
    Vdomain.append(Rhino.Geometry.Interval(netV,remainderVV))




if(remainderU != 0):
    nMax = equalU + 1
else:
    nMax = equalU
    
if(remainderV != 0):
    mMax = equalV +1 
else:
    mMax = equalV


for n in range(0,nMax):
    for m in range(0,mMax):
        UV.append(UVInterval(Udomain[n],Vdomain[m]))
        IsoSrf.append(Rhino.Geometry.Surface.Trim(srf,Udomain[n],Vdomain[m]))
# ---------- end dividesrf ----------
multiplication = Multiplication(A=dividesrf.nMax, B=dividesrf.mMax)
panel = Panel(dividesrf.remainderU)
panel_2 = Panel(dividesrf.remainderV)
panel_3 = Panel(dividesrf.srfULength)
panel_4 = Panel(dividesrf.mMax)
panel_5 = Panel(dividesrf.srfVLength)
panel_6 = Panel(dividesrf.nMax)
series = Series(Start=0, Step=1, Count=multiplication)
bnd = Bounds(Numbers=series)
remap = RemapNumbers(Value=series, Source=bnd, Target=Domain(0.687, 0.832))  # -> Mapped, Clipped
panel_7 = Panel(dividesrf.UV)
panel_8 = Panel(dividesrf.Udomain)
panel_9 = Panel(dividesrf.Vdomain)
hsv = ColourHSV(Alpha=0.2, Hue=remap.Mapped, Saturation=1, Value=1)
preview = CustomPreview(Geometry=dividesrf.IsoSrf, Material=hsv)
